# Grasshopper definition ParametricCityGeneratorV3.1.gh (Grasshopper 1.0.7)

# ----
# ATTENTION:
# Run Grasshopper under Rhino 7.0 to avoid errors
# Part A - I: Network Generation
# Bnd, Brep Item: Boundary of the whole city
# RdA, Curve List: Primary roads
# Crt1, int Item: Blocks with area over Crt1 * factor should be divided by secondary roads
# AmpC1, double Item: Closer to primary roads - Crt1 * (1 - AmpC1), farther to primary roads - Crt1 * (1 + AmpC1)
# Dist1, int Item: Judge if the block is closer to primary road, thus use AmpC1 as factor
# Crt2, int Item: Blocks with area over Crt2 * factor should be divided by roads in third class
# AmpC2, double Item: Closer to primary roads - Crt2 * (1 - AmpC2), farther to primary roads - Crt2 * (1 + AmpC2)
# Dist2, int Item: Judge if the block is closer to primary road, thus use AmpC2 as factor
# RndPara, double Item: Interval for the division point from the midpoint
# CtnRng1, int Item: Division center range from geometry center of larger block
# CtnRng2, int Item: Division center range from geometry center of smaller block
# LenRat, int Item: if the longest edge is too long, divide it
# Sd, int Item: Random seed
pipeline = GeometryPipeline(
    GroupByLayer=False,
    GroupByType=False,
    IncludeHidden=True,
    IncludeLocked=True,
    LayerFilter="RdA",
    NameFilter="*",
    SublayerFiltering=True,
    TypeFilter=4)
ctnrng1 = Slider(150, range=0..300)
ctnrng2 = Slider(10, range=0..300)
ampc1 = Slider(0.4, range=0..0.8)
ampc2 = Slider(0.5, range=0..0.8)
lenrat = Slider(6, range=2..15)
crt1 = Slider(640000, range=0..1000000)
crt2 = Slider(25600, range=0..1000000)
# INPUT: boundary + Primary Roads
# OUTPUT: Secondary Roads + Minor Roads + blocks
# 
# STEP1:
# boundary + primary roads -> larger blocks
# 
# STEP2:
# larger blocks with area over Crt1 -> divide into 4 pcs by secondary roads
# points from a range from center
# 
# STEP3:
# center distance to primary roads
# below l => larger Crt1, over l => smaller Crt1 (use factor)
# 
# STEP3.5:
# check length like TODO6
# 
# STEP4:
# blocks from step 2 with area over Crt1 with factor, divide by minor roads
# 
# STEP5:
# center distance to primary roads
# below l => 3 pcs & larger Crt2, over l => 4 pcs & Smaller Crt2
# divide until area below Crt2
# 
# STEP6:
# check length whose area below Crt2, over dist => divide border
number_slider = Slider(5, range=1..10)
geo = Geometry(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)
geo_2 = Geometry([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])
c_script = CSharpScript(
    Bnd=geo,
    RdA=geo_2,
    Crt1=crt1,
    AmpC1=ampc1,
    Dist1=Slider(400, range=0..500),
    Crt2=crt2,
    AmpC2=ampc2,
    Dist2=Slider(250, range=0..500),
    RndPara=Slider(0.05, range=0..0.5),
    CtnRng1=ctnrng1,
    CtnRng2=ctnrng2,
    LenRat=lenrat,
    Sd=number_slider)  # -> out, BLOCKS, RDA, RDB, RDC; inputs Bnd: Brep, RdA: list of Curve, Crt1: Int32, AmpC1: Double, Dist1: Int32, Crt2: Int32, AmpC2: Double, Dist2: Int32, RndPara: Double, CtnRng1: Int32, CtnRng2: Int32, LenRat: Int32, Sd: Int32
# ---------- c_script: C# ----------
    // initialize
    Random rand = new Random(Sd);
    List<Curve> RdB = new List<Curve>();
    List<Curve> RdC = new List<Curve>();
    List<Block> blocks = new List<Block>();
    Block city = new Block(Bnd);
    // divide the city by Road A, get a list of blocks
    Brep[] initbreps = Block.executeDivision(city, RdA);
    foreach (Brep initbrep in initbreps) {
      blocks.Add(new Block(initbrep));
    }

    // divide all, again and again, until all area is smaller than Crt2
    // calc the distance to Road A, determine factors to Crt1
    // update a new division function
    while (Block.checkToDivision(blocks, Crt1, RdA, Dist1, AmpC1)) {
      List<Block> tmp0 = new List<Block>(blocks);
      foreach (Block block in tmp0) {
        // check by length first
        if (block.checkByLength(LenRat).IsValid) {
          // true, means need a division first
          List<Curve> division = block.divisionAtLongest(rand, RndPara);
          RdB.AddRange(division);
          
          Brep[] dividedbrep = Block.executeDivision(block, division);
          blocks.Remove(block);
          foreach (Brep brep in dividedbrep) {
            blocks.Add(new Block(brep));
          }
        }
      }
      // do check division again
      if (Block.checkToDivision(blocks, Crt1, RdA, Dist1, AmpC1)) {
        // do the division
        List<Block> tmp = new List<Block>(blocks);
        foreach (Block block in tmp) {
          if (block.Area > Crt1 * block.isNearToRdA(RdA, Dist1, AmpC1)) {
            List<Curve> division = block.setDivisionB(rand, CtnRng1, RndPara);
            RdB.AddRange(division);

            Brep[] dividedbrep = Block.executeDivision(block, division);
            blocks.Remove(block);
            foreach (Brep brep in dividedbrep) {
              blocks.Add(new Block(brep));
            }
          }
        }
      }
    }

    // divide until all smaller to the last step, Crt3
    // calc the distance to Road A, determine factors to Crt2
    // determine the division pcs, divide on longer egdes
    while (Block.checkToDivision(blocks, Crt2, RdA, Dist2, AmpC2)) {
      List<Block> tmp0 = new List<Block>(blocks);
      foreach (Block block in tmp0) {
        // check by length first
        if (block.checkByLength(LenRat).IsValid) {
          // true, means need a division first
          List<Curve> division = block.divisionAtLongest(rand, RndPara);
          RdC.AddRange(division);
          
          Brep[] dividedbrep = Block.executeDivision(block, division);
          blocks.Remove(block);
          foreach (Brep brep in dividedbrep) {
            blocks.Add(new Block(brep));
          }
        }
      }
      if (Block.checkToDivision(blocks, Crt2, RdA, Dist2, AmpC2)) {
        // do the division
        List<Block> tmp = new List<Block>(blocks);
        foreach (Block block in tmp) {
          if (block.Area > Crt2 * block.isNearToRdA(RdA, Dist2, AmpC2)) {
            List<Curve> division = block.setDivisionC(RdA, Dist2, AmpC2, rand, CtnRng2, RndPara);
            RdC.AddRange(division);

            Brep[] dividedbrep = Block.executeDivision(block, division);
            blocks.Remove(block);
            foreach (Brep brep in dividedbrep) {
              blocks.Add(new Block(brep));
            }
          }
        }
      }
    }
    
    // output
    List<Brep> outs = new List<Brep>();
    foreach (Block block in blocks) {
      outs.Add(block.Brp);
    }

    BLOCKS = outs;
    RDA = RdA;
    RDB = RdB;
    RDC = RdC;
# ---------- c_script: C# additional code ----------
  public const double inter_tol = 0.001;
  public class Block
  {
    // initialize
    public Brep Brp;
    // public List<Point3d> Ends;
    public Point3d Center;
    public double Area;

    // constructor
    public Block (Brep brep)
    {
      this.Brp = brep;
      // List<Point3d> ends = new List<Point3d>();
      // var vertices = brep.Vertices;
      // foreach (BrepVertex bv in vertices) {
      //   ends.Add(bv.Location);
      // }
      // this.Ends = ends;

      // center
      AreaMassProperties ctn_area = AreaMassProperties.Compute(brep.DuplicateBrep());
      this.Center = ctn_area.Centroid;
      // area
      this.Area = ctn_area.Area;
    }

    // ***basic divisions**
    // get the edge pairs across, build division lines, used in class B
    public List<Curve> divisionByPairs (Random rand, double pararng)
    {
      List<Line> edges = new List<Line>();
      foreach (BrepEdge edge in this.Brp.Edges) {
        edges.Add(new Line(edge.PointAtStart, edge.PointAtEnd));
      }
      int usedid = 0;
      for (int i = 1; i < 4; i++) {
        if (edges[0].MinimumDistanceTo(edges[i]) > inter_tol) {
          usedid = i;
          break;
        }
      }
      Line div1 = new Line(edges[0].PointAt(rand.NextDouble() * pararng * 2 + 0.5 - pararng), edges[usedid].PointAt(rand.NextDouble() * pararng * 2 + 0.5 - pararng));
      List<Line> rest = edges.Where(edge => edges.IndexOf(edge) != 0 && edges.IndexOf(edge) != usedid).ToList();
      Line div2 = new Line(rest[0].PointAt(rand.NextDouble() * pararng * 2 + 0.5 - pararng), rest[1].PointAt(rand.NextDouble() * pararng * 2 + 0.5 - pararng));
      return new List<Curve>() {div1.ToNurbsCurve(), div2.ToNurbsCurve()};
    }

    // normal division, from center to all edges, used in class B and C
    public List<Curve> divisionFromCenter (Random rand, int cntrng, double pararng)
    {
      List<Curve> division = new List<Curve>();
      // get a random point within a range from the center, use as the divide starting point to each edge
      Point3d divcent = new Point3d(this.Center.X + rand.Next(-cntrng, cntrng), this.Center.Y + rand.Next(-cntrng, cntrng), 0);
      // each edge, get a point within a certain range from the midpoint
      foreach (BrepEdge edge in this.Brp.Edges) {
        Curve edgecrv = edge.ToNurbsCurve();
        edgecrv.Domain = new Interval(0, 1);
        // a point on edge, (0.5-pararng,0.5+pararng)
        Point3d divpt = edgecrv.PointAt(rand.NextDouble() * pararng * 2 + 0.5 - pararng);
        Line divln = new Line(divcent, divpt);
        division.Add(divln.ToNurbsCurve());
      }
      return division;
    }

    // get the pair division, and eliminate one segments, used in class C
    public List<Curve> divisionByPairsEliminated (Random rand, int cntrng, double pararng)
    {
      // find division by pairs
      List<Line> edges = new List<Line>();
      foreach (BrepEdge edge in this.Brp.Edges) {
        edges.Add(new Line(edge.PointAtStart, edge.PointAtEnd));
      }
      int usedid = 0;
      for (int i = 1; i < 4; i++) {
        if (edges[0].MinimumDistanceTo(edges[i]) > inter_tol) {
          usedid = i;
          break;
        }
      }
      List<Point3d> pts = new List<Point3d>();
      for (int i = 0; i < 4; i++) {
        pts.Add(edges[i].PointAt(rand.NextDouble() * pararng * 2 + 0.5 - pararng));
      }
      Line div1 = new Line(pts[0], pts[usedid]);
      List<Point3d> rest = pts.Where(pt => pts.IndexOf(pt) != 0 && pts.IndexOf(pt) != usedid).ToList();
      Line div2 = new Line(rest[0], rest[1]);
      // find the longest segment (means in the narrow end of the block)
      double para1, para2;
      Rhino.Geometry.Intersect.Intersection.LineLine(div1, div2, out para1, out para2);
      List<Curve> divisions = new List<Curve>();
      Division dv1 = new Division(div1, para1);
      Division dv2 = new Division(div2, para2);
      if (dv1.MaxSegLen > dv2.MaxSegLen) {
        // eliminate dv1 longer seg
        divisions.Add(dv1.MinSeg.ToNurbsCurve());
        divisions.Add(div2.ToNurbsCurve());
      }
      else {
        divisions.Add(dv2.MinSeg.ToNurbsCurve());
        divisions.Add(div1.ToNurbsCurve());
      }
      return divisions;
    }
    
    // divide once at the edge that is too long
    public List<Curve> divisionAtLongest (Random rand, double pararng)
    {
      // find the longest edge
      List<Line> lns = new List<Line>();
      List<double> lens = new List<double>();
      foreach (BrepEdge edge in this.Brp.Edges) {
        Line tmp = new Line(edge.PointAtStart, edge.PointAtEnd);
        lns.Add(tmp);
        lens.Add(tmp.Length);
      }
      double maxlen = lens.Max();
      Line maxln = lns[lens.IndexOf(maxlen)];
      // find the edge across
      int usedid = 0;
      for (int i = 0; i < lns.Count; i++) {
        if (maxln.MinimumDistanceTo(lns[i]) > inter_tol) {
          usedid = i;
          break;
        }
      }
      Line div = new Line(maxln.PointAt(rand.NextDouble() * pararng * 2 + 0.5 - pararng), lns[usedid].PointAt(rand.NextDouble() * pararng * 2 + 0.5 - pararng));
      return new List<Curve>() {div.ToNurbsCurve()};
    }

    // ***divide blocks in different class***
    // for larger blocks to be divided by Road B, no not use center if the block has 4 edges
    public List<Curve> setDivisionB (Random rand, int cntrng, double pararng)
    {
      if (this.Brp.Edges.Count == 4) {
        return this.divisionByPairs(rand, pararng);
      }
      else {
        return this.divisionFromCenter(rand, cntrng, pararng);
      }
    }

    // get the divide center
    public List<Curve> setDivisionC (List<Curve> RdA, int dist, double amp, Random rand, int cntrng, double pararng)
    {
      // when the block is far, and has 4 edges, eleminate
      //if (this.isNearToRdA(RdA, dist, amp) >= 1 && this.Brp.Edges.Count == 4) {
      //return this.divisionByPairsEliminated(rand, cntrng, pararng);
      //}
      //else {
      return this.divisionFromCenter(rand, cntrng, pararng);
      //}
    }

    // divide the father into sons
    public static Brep[] executeDivision(Block father, List<Curve> division)
    {
      Brep[] sons = father.Brp.Split(division, inter_tol);
      // cull null
      return sons.Where(brep => brep != null).ToArray();
    }

    // ***check division and distance***
    // check if all the blocks is below a area
    public static bool checkToDivision (List<Block> blocks, int area, List<Curve> RdA, int dist, double amp)
    {
      foreach (Block block in blocks) {
        if (block.Area > area * block.isNearToRdA(RdA, dist, amp)) {
          // need division
          return true;
        }
      }
      return false;
    }

    // check the distance to nearest primary road, and dicide the factor to use
    public double isNearToRdA (List<Curve> RdA, int dist, double amp)
    {
      List<double> dists = new List<double>();
      foreach (Curve crv in RdA) {
        Line ln = new Line(crv.PointAtStart, crv.PointAtEnd);
        dists.Add(ln.DistanceTo(this.Center, true));
      }
      if (dists.Min() > dist) {
        // too far, larger factor
        return 1 + amp;
      }
      else {
        // near, smaller factor
        return 1 - amp;
      }
    }

    // ***check the shape, length***
    // check the length, longest shortest
    public Line checkByLength (int rat)
    {
      List<Line> lns = new List<Line>();
      List<double> lens = new List<double>();
      foreach (BrepEdge edge in this.Brp.Edges) {
        Line tmp = new Line(edge.PointAtStart, edge.PointAtEnd);
        lns.Add(tmp);
        lens.Add(tmp.Length);
      }
      double maxlen = lens.Max();
      double minlen = lens.Min();
      if (maxlen / minlen >= rat) {
        return lns[lens.IndexOf(maxlen)];
      }
      else { return new Line(); }
    }
  }

  // define the line with intersections
  public class Division
  {
    public Line Ln;
    public double MaxSegLen;
    public Line MinSeg;

    public Division (Line ln, double para)
    {
      this.Ln = ln;
      Point3d div = this.Ln.PointAt(para);
      List<double> seglen = new List<double>();
      Line seg1 = new Line(div, ln.From);
      Line seg2 = new Line(div, ln.To);
      if (seg1.Length > seg2.Length) {
        this.MaxSegLen = seg1.Length;
        this.MinSeg = seg2;
      }
      else {
        this.MaxSegLen = seg2.Length;
        this.MinSeg = seg1;
      }
    }
  }
# ---------- end c_script ----------
geo_3 = Geometry(c_script.RDA)
geo_4 = Geometry(c_script.RDB)
rdb = Geometry(c_script.RDC)
preview = CustomPreview(Geometry=geo_4, Material=ColourSwatch(SwatchColor=RGB(255, 0, 0)))
preview_2 = CustomPreview(Geometry=rdb, Material=ColourSwatch(SwatchColor=RGB(77, 103, 255)))

# ----
# Display blocks in random colors
cluster = Cluster(geo=c_script.BLOCKS)  # -> geo_3, C; disabled
preview_3 = CustomPreview(Geometry=cluster.geo_3, Material=cluster.C)  # disabled

pedoff = Slider(2, range=0..10)

# ----
# Part A - II: Street + Block Generation
# Blocks, Brep List: Input the blocks to offset
# Boundary, Curve Item: Offset the boundary to ensure border cutoff
# RdA, Line List: Primary roads
# HalfWA, double Item: Width (Offset value) for RdA
# RdB, Line List: Secondary roads
# HalfWB, double Item: Width (Offset value) for RdB
# RdC, Line List: Minor roads
# HalfWC, double Item: Width (Offset value) for RdC
# PedOff, double Item: Width of pedestrian to offset
# INPUT: blocks + Primary Roads + Secondary Roads + Minor Roads + 3 offset distance
# OUTPUT: Blocks with building setback + pedestrian outline
# 
# STEP1:
# for each block, check all the edges, on road a => offset value a, on b => offset b, on c => offset c
# 
# STEP2:
# cut the block
halfwc = Slider(2.436, range=0..10)
halfwa = Slider(10, range=0..10)
halfwb = Slider(4.699, range=0..10)
c_script_2 = CSharpScript(
    Blocks=c_script.BLOCKS,
    Boundary=geo,
    RdA=geo_3,
    HalfWA=halfwa,
    RdB=geo_4,
    HalfWB=halfwb,
    RdC=rdb,
    HalfWC=halfwc,
    PedOff=pedoff)  # -> out, BuildingSetback, PedestrianOutline; inputs Blocks: list of Brep, Boundary: Curve, RdA: list of Line, HalfWA: Double, RdB: list of Line, HalfWB: Double, RdC: list of Line, HalfWC: Double, PedOff: Double
# ---------- c_script_2: C# ----------
    // initialize
    List<Block> blocks = new List<Block>();
    foreach (Brep brep in Blocks) {
      Block block = new Block(brep);
      blocks.Add(block);
    }

    Curve[] boundoffset = Boundary.Offset(Plane.WorldXY, HalfWA, inter_tol, CurveOffsetCornerStyle.Sharp);
    Curve[] n_boundoffset = Boundary.Offset(Plane.WorldXY, -HalfWA, inter_tol, CurveOffsetCornerStyle.Sharp);

    // each block, each edge, check the location
    foreach (Block block in blocks) {
      List<Curve> cutter = block.offsetEdges(RdA, RdB, HalfWA, HalfWB, HalfWC, PedOff);
      cutter.Add(boundoffset[0]);
      cutter.Add(n_boundoffset[0]);
      block.cutBrep(cutter);
    }
    
    // pedestrian
    List<Curve> peds = new List<Curve>();
    foreach (Block block in blocks) {
      Curve[] outline = Curve.JoinCurves(block.Brp.Edges);
      Curve[] ped = outline[0].Offset(block.Center, Vector3d.ZAxis, -PedOff, inter_tol, CurveOffsetCornerStyle.Sharp);
      peds.Add(ped[0]);
    }

    // out
    List<Brep> outs = new List<Brep>();
    foreach (Block block in blocks) {
      outs.Add(block.Brp);
    }

    BuildingSetback = outs;
    PedestrianOutline = peds;
# ---------- c_script_2: C# additional code ----------
  public const double inter_tol = 0.001;
  public const double extent = 10;
  // class block
  public class Block
  {
    // initialize
    public Brep Brp;
    public Point3d Center;

    // constructor
    public Block (Brep brp)
    {
      this.Brp = brp;
      AreaMassProperties amp = AreaMassProperties.Compute(brp);
      this.Center = amp.Centroid;
    }

    // offset the edge
    public List<Curve> offsetEdges (List<Line> RdA, List<Line> RdB, double wa, double wb, double wc, double ped)
    {
      List<Curve> offseted = new List<Curve>();
      foreach (BrepEdge edge in this.Brp.Edges) {
        // if on rda
        if (Block.offsetValue(RdA, edge)) {
          // offset wa
          double w = wa + ped;
          Curve[] offset = edge.ToNurbsCurve().Offset(Plane.WorldXY, w, inter_tol, CurveOffsetCornerStyle.Sharp);
          Curve[] noffset = edge.ToNurbsCurve().Offset(Plane.WorldXY, -w, inter_tol, CurveOffsetCornerStyle.Sharp);
          Line tmp = new Line(offset[0].PointAtStart, offset[0].PointAtEnd);
          Line n_tmp = new Line(noffset[0].PointAtStart, noffset[0].PointAtEnd);
          tmp.Extend(extent, extent);
          n_tmp.Extend(extent, extent);
          offseted.Add(tmp.ToNurbsCurve());
          offseted.Add(n_tmp.ToNurbsCurve());
        }
        else if (Block.offsetValue(RdB, edge)) {
          // on rdb, offset wb
          double w = wb + ped;
          Curve[] offset = edge.ToNurbsCurve().Offset(Plane.WorldXY, w, inter_tol, CurveOffsetCornerStyle.Sharp);
          Curve[] noffset = edge.ToNurbsCurve().Offset(Plane.WorldXY, -w, inter_tol, CurveOffsetCornerStyle.Sharp);
          Line tmp = new Line(offset[0].PointAtStart, offset[0].PointAtEnd);
          Line n_tmp = new Line(noffset[0].PointAtStart, noffset[0].PointAtEnd);
          tmp.Extend(extent, extent);
          n_tmp.Extend(extent, extent);
          offseted.Add(tmp.ToNurbsCurve());
          offseted.Add(n_tmp.ToNurbsCurve());
        }
        else {
          // offset wc
          double w = wc + ped;
          Curve[] offset = edge.ToNurbsCurve().Offset(Plane.WorldXY, w, inter_tol, CurveOffsetCornerStyle.Sharp);
          Curve[] noffset = edge.ToNurbsCurve().Offset(Plane.WorldXY, -w, inter_tol, CurveOffsetCornerStyle.Sharp);
          Line tmp = new Line(offset[0].PointAtStart, offset[0].PointAtEnd);
          Line n_tmp = new Line(noffset[0].PointAtStart, noffset[0].PointAtEnd);
          tmp.Extend(extent, extent);
          n_tmp.Extend(extent, extent);
          offseted.Add(tmp.ToNurbsCurve());
          offseted.Add(n_tmp.ToNurbsCurve());
        }
      }
      return offseted;
    }

    // check the location of edges, maxdistance to rd == 0 -> on that class road
    public static bool offsetValue(List<Line> a, BrepEdge edge)
    {
      foreach (Line rd in a) {
        if (rd.DistanceTo(edge.PointAtStart, true) < inter_tol && rd.DistanceTo(edge.PointAtEnd, true) < inter_tol) {
          // on this road
          return true;
        }
      }
      // none
      return false;
    }

    // divide and get the area largest
    public void cutBrep (List<Curve> cutter)
    {
      Brep[] cuts = this.Brp.Split(cutter, inter_tol);
      cuts = cuts.Where(brep => brep != null).ToArray();
      List<double> areas = new List<double>();
      List<Brep> breps = new List<Brep>();
      foreach (Brep brep in cuts) {
        AreaMassProperties am = AreaMassProperties.Compute(brep);
        areas.Add(am.Area);
        breps.Add(brep);
      }
      this.Brp = breps[areas.IndexOf(areas.Max())];
    }
  }
# ---------- end c_script_2 ----------
geo_5 = Geometry(c_script_2.PedestrianOutline)

# ----
# Part B - I: Density Generation
# subS, Brep List: Input all the blocks
# RdA, Line List: Road Class A, primary roads
# RdB, Line List: Road Class B, secondary roads
# RdC, Line List: Road Class C, minor roads
# ClsA, int List: Critical values for RdA
# ClsB, int List: Critical values for RdB
# ClsC, int List: Critical values for RdC
# Wgt, double List: weight of influence on desity from roads
# HtA, double List: Mapping heights to RdA
# HtB, double List: Mapping heights to RdB
# HtC, double List: Mapping heights to RdC
# TrgA, bool: Calculate RdA
# TrgB, bool: Calculate RdB
# TrgC, bool: Calculate RdC
# ATTENTION:
# if (Minor roads are calculated) {
#     it'll take a very long time to map the density;
#     return taks manager;
# }
number_slider_2 = Slider(180, range=0..350)
# INPUT: blocks + Primary Roads + Secondary Roads + Minor Roads
# 
# STEP1:
# calculate the min distance from each block center to road a, b, c
# 
# STEP2:
# classify the distance, map to height value (density later)
# 
# STEP3:
# add up the height value for 3 roads
toggle = BooleanToggle(False)
merge = Merge(Data1=Slider(240, range=0..350), Data2=number_slider_2, Data3=Slider(90, range=0..350))
merge_2 = Merge(Data1=Slider(120, range=0..350), Data2=Slider(90, range=0..350), Data3=Slider(30, range=0..350))
merge_3 = Merge(Data1=Slider(350, range=0..350), Data2=Slider(124, range=0..350), Data3=Slider(104, range=0..350))
merge_4 = Merge(Data1=Slider(1.2, range=0..3), Data2=Slider(1, range=0..3), Data3=Slider(1, range=0..3))
merge_5 = Merge(Data1=Slider(3, range=0..10), Data2=Slider(6, range=0..10), Data3=Slider(9, range=0..10))
merge_6 = Merge(Data1=Slider(3, range=0..10), Data2=Slider(6, range=0..10), Data3=Slider(9, range=0..10))
merge_7 = Merge(Data1=Slider(3, range=0..10), Data2=Slider(6, range=0..10), Data3=Slider(8, range=0..10))
flatten = FlattenTree(Tree=geo_3, Path="{0}")
flatten_2 = FlattenTree(Tree=geo_4, Path="{0}")
flatten_3 = FlattenTree(Tree=rdb, Path="{0}")
# INPUT:Relative density
# 
# STEP1:
# Remap the density to FAR [0.5, 20]
# let the user adjust overall density rate of the whole city
srf = Surface(c_script_2.BuildingSetback)
c_script_3 = CSharpScript(
    subS=srf,
    RdA=flatten,
    RdB=flatten_2,
    RdC=flatten_3,
    ClsA=merge,
    ClsB=merge_2,
    ClsC=merge_3,
    Wgt=merge_4,
    HtA=merge_5,
    HtB=merge_6,
    HtC=merge_7,
    TrgA=Toggle(True),
    TrgB=Toggle(True),
    TrgC=toggle)  # -> out, Block, Density; inputs subS: list of Brep, RdA: list of Line, RdB: list of Line, RdC: list of Line, ClsA: list of Int32, ClsB: list of Int32, ClsC: list of Int32, Wgt: list of Double, HtA: list of Double, HtB: list of Double, HtC: list of Double, TrgA: Boolean, TrgB: Boolean, TrgC: Boolean
# ---------- c_script_3: C# ----------
    // construct array of block instances
    Block[] blocks = new Block[subS.Count];
    for (int i = 0; i < subS.Count; i++) {
      Block block = new Block(subS[i]); // we have overload here, no worry about brep vs surface
      blocks[i] = block;
    }

    // construct array of roads with Class and Height
    Road[] rda = new Road[RdA.Count];
    Road[] rdb = new Road[RdB.Count];
    Road[] rdc = new Road[RdC.Count];
    // RdA
    if (TrgA) {
      for (int i = 0; i < RdA.Count; i++) {
        Road rd = new Road(RdA[i], ClsA, HtA);
        rda[i] = rd;
      }
    }
    // RdB
    if (TrgB) {
      for (int i = 0; i < RdB.Count; i++) {
        Road rd = new Road(RdB[i], ClsB, HtB);
        rdb[i] = rd;
      }
    }
    // RdC
    if (TrgC) {
      for (int i = 0; i < RdC.Count; i++) {
        Road rd = new Road(RdC[i], ClsC, HtC);
        rdc[i] = rd;
      }
    }

    // calculate and classify
    List<double> heights = new List<double>();
    //List<Brep> breps = new List<Brep>();
    List<Surface> surfaces = new List<Surface>();
    foreach (Block block in blocks) {
      // class A
      if (TrgA) {
        block.HA = block.SetHeight(rda);
      }
      // class B
      if (TrgB) {
        block.HB = block.SetHeight(rdb);
      }
      // class C
      if (TrgC) {
        block.HC = block.SetHeight(rdc);
      }
      // overall
      block.SetAllHeight(Wgt);
      // output
      heights.Add(block.HAll);
      surfaces.Add(block.Srf);
    }

    // output
    Block = surfaces;
    Density = heights;
# ---------- c_script_3: C# additional code ----------
  // define block
  public class Block
  {
    // initialize
    public Surface Srf;
    public Brep Brp;
    public double HA;
    public double HB;
    public double HC;
    public double HAll;
    public List<Point3d> Ends;

    // constructor FROM BREP
    public Block(Brep brep)
    {
      this.Srf = brep.Faces[0];
      this.Brp = brep;
      this.HA = 0;
      this.HB = 0;
      this.HC = 0;
      List<Point3d> ends = new List<Point3d>();
      var vertices = brep.Vertices;
      foreach (BrepVertex bv in vertices) {
        ends.Add(bv.Location);
      }
      this.Ends = ends;
    }

    // get center
    public Point3d Center()
    {
      int count = 0;
      Point3d sum = new Point3d(0, 0, 0);
      foreach (Point3d pt in this.Ends) {
        sum += pt;
        count++;
      }
      return sum / count;
    }

    // get the min dist from center to all roads of same class
    public double SetHeight (Road[] rds)
    {
      List<double> dists = new List<double>();
      foreach (Road rd in rds) {
        dists.Add(rd.Ln.DistanceTo(this.Center(), false));
      }
      double mindist = dists.Min();
      return Block.DistToHeight(mindist, rds);
    }

    // generate the height
    public static double DistToHeight (double dist, Road[] rds)
    {
      List<int> cls = rds[0].Cls;
      List<double> ht = rds[0].Ht;
      if (dist <= cls[0] && dist > cls[1]) {
        return ht[0];
      }
      else if (dist <= cls[1] && dist > cls[2]) {
        return ht[1];
      }
      else if (dist <= cls[2]) {
        return ht[2];
      }
      else {
        return 0;
      }
    }

    // overall height
    public void SetAllHeight (List<double> wt)
    {
      this.HAll = this.HA * wt[0] + this.HB * wt[1] + this.HC * wt[2];
    }
  }

  // define roads
  public class Road
  {
    // initialize
    public Line Ln;
    public List<int> Cls;
    public List<double> Ht;

    // constructor
    public Road (Line ln, List<int> cls, List<double> ht)
    {
      this.Ln = ln;
      this.Cls = cls;
      this.Ht = ht;
    }
  }
# ---------- end c_script_3 ----------

# ----
# Display blocks by density
display = Display(geo=c_script_3.Block, F=c_script_3.Density, K=c_script_3.Density, t=c_script_3.Density)  # -> E, C
preview_4 = CustomPreview(Geometry=c_script_3.Block, Material=display.C)

# ----
# Part B - II: Density Remapping
# Density, double List: Raw density for blocks before remapping
# RemapIndex, double Item: Overall density for the whole city, remap scale from raw density to real density, closer to 1 means higher overall density
remapindex = Slider(0.67, range=0..1)
# INPUT: Remapped RAR + 3 BSR + blocks + Primary & Secondary roads + tower ratio
# 
# STEP1:
# divide blocks based on FAR inputThe bigger FAR is, the less parcels
# the block would be divided into
# 
# STEP2:
# generate different building forms based on FAR & BSR input
# 
# STEP3:
# compare the min distances between each line of block edges to the set of Road A and Road B
# 
# STEP4:
# group edge lines into two groups:  Road A and Road B
# offset lines to create base surface for tower extrusion
# 
# STEP5:
# in FAR stage 3, calculate Tower extrusion
# height
# 
# STEP6:
# generate extrusion for RoadA Towers &
# RoadB Towers
c_script_4 = CSharpScript(Density=c_script_3.Density, RemapIndex=remapindex)  # -> out, FAR; inputs Density: list of Double, RemapIndex: Double
# ---------- c_script_4: C# ----------
    // remap the input density into FAR
    // (0.5, 20)
    double max = Density.Max();
    double min = Density.Min();
    double factor = RemapIndex * 19.5 / (max - min);
    List<double> fars = new List<double>();

    for (int m = 0; m < Density.Count; m++) {
      double far = (Density[m] - min) * factor + 0.5;
      fars.Add(far);
    }

    FAR = fars;
# ---------- end c_script_4 ----------

# ----
# Part C: Main Building + Tower Generator
# ATTENTION:
# Graft is used here to generate Untrimmed Surface from trimmed surface
# Blocks, Surface List: Converted Untrimmed Surfaces from blocks
# Density, double List: Raw density for blocks before remapping
# FAR, double List: FAR for each block
# BSR1, double Item: the overall density for blocks with lowest FAR, will change the BSR inside
# BSR2, double Item: the overall density for blocks in between
# BSR3, double Item: the overall density for blocks with highest FAR
# RdA, Curve List: used to calculate the location of towerP
# RdS, Curve List: used to calculate the location of towerS
# TRatio, double Item: the ratio of towerP and towerS in area
number_slider_3 = Slider(0.7, range=0.5..0.99)
tratio = Slider(0.72, range=0..1)
boundary = BoundarySurfaces(Edges=graft(c_script_3.Block), UseTasks=False)  # -> flatten(Surfaces)
c_script_5 = CSharpScript(
    Blocks=boundary,
    FAR=c_script_4.FAR,
    BSR1=number_slider_3,
    BSR2=Slider(0.6, range=0.3..0.6),
    BSR3=Slider(0.6, range=0.4..0.8),
    RdA=geo_3,
    RdB=geo_4,
    TRatio=tratio)  # -> out, TowerP, TowerS, Outline, Buildings, Yard; inputs Blocks: list of Surface, FAR: list of Double, BSR1: Double, BSR2: Double, BSR3: Double, RdA: list of Curve, RdB: list of Curve, TRatio: Double
# ---------- c_script_5: C# usings ----------
using System.IO;
using System.Linq;
using System.Data;
using System.Drawing;
using System.Reflection;
using System.Windows.Forms;
using System.Xml;
using System.Xml.Linq;
using System.Runtime.InteropServices;

using Rhino.DocObjects;
using Rhino.Collections;
using GH_IO;
using GH_IO.Serialization;
# ---------- c_script_5: C# ----------
    // initialize
    // get the list of class Buildings, each item contains the outline of the building and the FAR
    List<Building> buildings = new List<Building>();
    for (int m = 0; m < Blocks.Count; m++) {
      double Vspan = Math.Floor(5 / FAR[m] + 1);
      int V = Convert.ToInt16(Vspan);
      double Uspan = Math.Floor(1 / FAR[m] + 1);
      int U = Convert.ToInt16(Uspan);
      Interval normDom = new Interval (0, 1);
      // Surface srf = Blocks[m].Faces[0];
      Surface srf = Blocks[m];
      srf.SetDomain(0, normDom);
      srf.SetDomain(1, normDom);
      double du = 1.0 / U;
      double dv = 1.0 / V;

      for (int i = 0; i < V; i++){
        for (int j = 0; j < U; j++){

          Mesh subMesh = new Mesh();
          subMesh.Vertices.Add(srf.PointAt(du * j, dv * i));
          subMesh.Vertices.Add(srf.PointAt(du * (j + 1), dv * i));
          subMesh.Vertices.Add(srf.PointAt(du * (j + 1), dv * (i + 1)));
          subMesh.Vertices.Add(srf.PointAt(du * j, dv * (i + 1)));
          subMesh.Faces.AddFace(0, 1, 2, 3);

          Polyline[] curves = subMesh.GetNakedEdges();
          Building bldg = new Building(curves[0], FAR[m]);
          buildings.Add(bldg);
        }
      }
    }

    List<Brep> outbuildings = new List<Brep>();
    List<Curve> outyards = new List<Curve>();
    List<Brep> outtests1 = new List<Brep>();
    List<Brep> outtests2 = new List<Brep>();
    // offset all the buildings
    foreach (Building bldg in buildings) {
      // check the FAR, 0.5-2
      if (bldg.FAR >= 0.5 && bldg.FAR < 2) {
        // offset
        bldg.buildingGenerator1(BSR1);
        outbuildings.Add(bldg.Structure);
      }
        // far, 2-5
      else if (bldg.FAR >= 2 && bldg.FAR < 5) {
        bldg.buildingGenerator2(BSR2);
        outbuildings.Add(bldg.Structure);
        outyards.Add(bldg.InnerBorder);
      }
        // far, 2-5
      else if (bldg.FAR >= 5 && bldg.FAR <= 20) {
        bldg.buildingGenerator3(BSR3);
        outbuildings.Add(bldg.Structure);
        outyards.Add(bldg.InnerBorder);
        // find pri/sec borders
        bldg.setPriSec(RdA, RdB);
        // towerbaseP
        bldg.getPriTowerBase(BSR3);
        // towerbaseS
        bldg.getSecTowerBase(BSR3);
        // generate towers
        bldg.towerGenerator(BSR3, TRatio);
        outtests1.Add(bldg.TowerPStructure);
        outtests2.Add(bldg.TowerSStructure);
      }
    }

    // outs
    List<Polyline> outs = new List<Polyline>();
    foreach (Building bldg in buildings) {
      outs.Add(bldg.Outline);
    }

    Outline = outs;
    Buildings = outbuildings;
    Yard = outyards;
    TowerP = outtests1;
    TowerS = outtests2;
# ---------- c_script_5: C# additional code ----------
  public const double inter_tol = 0.001;
  public const double extent = 20;
  public class Building
  {
    // initialize
    public Polyline Outline;
    public double FAR;
    public Point3d Center;
    public Brep Structure;
    public Curve OuterBorder;
    public Curve InnerBorder;
    public List<Curve> PriLns;
    public List<Curve> SecLns;
    public Brep TowerP;
    public Brep TowerS;
    public Brep TowerPStructure;
    public Brep TowerSStructure;

    // constructor
    public Building (Polyline outline, double far)
    {
      this.Outline = outline;
      this.FAR = far;
      AreaMassProperties amp = AreaMassProperties.Compute(outline.ToNurbsCurve());
      this.Center = amp.Centroid;
      this.Structure = new Brep();
    }

    // generat far 0.5-2
    public void buildingGenerator1 (double density)
    {
      // density * offsetmax
      double off = (1 - density) * this.offsetMax();
      Curve[] offset = this.Outline.ToNurbsCurve().Offset(this.Center, Vector3d.ZAxis, off, inter_tol, CurveOffsetCornerStyle.Sharp);
      BrepFace basement = Brep.CreatePlanarBreps(offset[0], inter_tol)[0].Faces[0];
      double floor = Math.Floor(this.FAR / density);
      double len = this.Outline.Length;
      if (floor >= 1 && off < len / 20) {
        Brep ex = basement.CreateExtrusion(new Line(0, 0, 0, 0, 0, floor * 3).ToNurbsCurve(), true);
        this.Structure = ex;
      }
      else {
        Brep ex = basement.CreateExtrusion(new Line(0, 0, 0, 0, 0, 3).ToNurbsCurve(), true);
        this.Structure = ex;
      }
      this.OuterBorder = offset[0];
    }

    // generate far 2-5
    public void buildingGenerator2 (double density)
    {
      // offset 2m as setback and outerborder
      Curve[] outeroffset = this.Outline.ToNurbsCurve().Offset(this.Center, Vector3d.ZAxis, 2, inter_tol, CurveOffsetCornerStyle.Sharp);
      this.OuterBorder = outeroffset[0];
      // density * offsetmax
      double off = density * (this.offsetMax() - 2);
      // offset the outerborder
      Curve[] inneroffset = outeroffset[0].Offset(this.Center, Vector3d.ZAxis, off, inter_tol, CurveOffsetCornerStyle.Sharp);
      this.InnerBorder = inneroffset[0];
      // loft, extrude
      Brep[] loft = Brep.CreatePlanarBreps(new List<Curve>() {this.OuterBorder, this.InnerBorder}, inter_tol);
      double floor = Math.Floor(this.FAR / density);
      Brep ex = loft[0].Faces[0].CreateExtrusion(new Line(0, 0, 0, 0, 0, floor * 3).ToNurbsCurve(), true);
      this.Structure = ex;
    }

    // generate far 5-20
    public void buildingGenerator3 (double density)
    {
      // offset 2m
      Curve[] outeroffset = this.Outline.ToNurbsCurve().Offset(this.Center, Vector3d.ZAxis, 2, inter_tol, CurveOffsetCornerStyle.Sharp);
      this.OuterBorder = outeroffset[0];
      // density * offsetmax
      double off = density * (this.offsetMax() - 2);
      // offset the outerborder
      Curve[] inneroffset = outeroffset[0].Offset(this.Center, Vector3d.ZAxis, off, inter_tol, CurveOffsetCornerStyle.Sharp);
      this.InnerBorder = inneroffset[0];
      // loft, extrude
      Brep[] loft = Brep.CreatePlanarBreps(new List<Curve>() {this.OuterBorder, this.InnerBorder}, inter_tol);
      //double floor = Math.Floor(this.FAR / density);
      double floor = 5;
      Brep ex = loft[0].Faces[0].CreateExtrusion(new Line(0, 0, 0, 0, 0, floor * 3).ToNurbsCurve(), true);
      this.Structure = ex;
    }

    // find the shortest offset value
    public double offsetMax ()
    {
      Brep[] brp = Brep.CreatePlanarBreps(this.Outline.ToNurbsCurve(), inter_tol);
      List<double> dists = new List<double>();
      foreach (BrepEdge ed in brp[0].Edges) {
        Line ln = new Line(ed.PointAtStart, ed.PointAtEnd);
        dists.Add(ln.DistanceTo(this.Center, false));
      }
      return dists.Min();
    }

    // get borders closer to primary/secondary roads
    public void setPriSec (List<Curve> RdA, List<Curve> RdB)
    {
      //Block bl = new Block(this.Outline);
      Brep[] brp = Brep.CreatePlanarBreps(this.Outline.ToNurbsCurve(), inter_tol);
      List<Curve> primary = new List<Curve>();
      List<Curve> secondary = new List<Curve>();
      foreach (BrepEdge ed in brp[0].Edges) {
        Point3d mid = (ed.PointAtStart + ed.PointAtEnd) / 2;
        // RdA
        foreach (Curve rd in RdA) {
          Line rdln = new Line(rd.PointAtStart, rd.PointAtEnd);
          double dist = rdln.DistanceTo(mid, true);
          if (dist < 30) {
            Curve cToAdd = new Line(ed.PointAtStart, ed.PointAtEnd).ToNurbsCurve();
            primary.Add(cToAdd);
            break;
          }
          else {
            // if not break, then calc RdB
            foreach (Curve rd2 in RdB) {
              Line rdln2 = new Line(rd2.PointAtStart, rd2.PointAtEnd);
              double dist2 = rdln2.DistanceTo(mid, true);
              if (dist2 < 15) {
                Curve cToAdd = new Line(ed.PointAtStart, ed.PointAtEnd).ToNurbsCurve();
                secondary.Add(cToAdd);
                break;
              }
            }
          }
        }
      }
      this.PriLns = primary;
      this.SecLns = secondary;
    }

    // cut the area with pri/sec lines
    public void getPriTowerBase (double density)
    {
      // brp of self
      if (this.PriLns.Count == 0) { return; }
      Brep[] brp = Brep.CreatePlanarBreps(this.OuterBorder, inter_tol);
      // ensure no duplicated curves here !important
      List<Curve> joins = new List<Curve>();
      List<Point3d> start = new List<Point3d>();
      List<Point3d> end = new List<Point3d>();
      foreach (Curve cv in this.PriLns) {
        if (start.Contains(cv.PointAtStart)) { continue; }
        if (end.Contains(cv.PointAtEnd)) { continue; }
        start.Add(cv.PointAtStart);
        end.Add(cv.PointAtEnd);
        joins.Add(cv);
      }
      Curve[] c = Curve.JoinCurves(joins, inter_tol);
      double off = density * (this.offsetMax() - 2);
      Curve[] offset = c[0].Offset(this.Center, Vector3d.ZAxis, off, inter_tol, CurveOffsetCornerStyle.Sharp);
      if (!offset[0].IsValid) { return; }
      Curve extended = offset[0].Extend(CurveEnd.Both, extent, CurveExtensionStyle.Line);
      Brep[] cutted = brp[0].Split(new List<Curve> {extended}, inter_tol);
      if (cutted.Length == 0) { return; }
      cutted = cutted.Where(brptmp => brptmp != null).ToArray();
      List<double> areas = new List<double>();
      List<Brep> parts = new List<Brep>();
      foreach (Brep cut in cutted) {
        AreaMassProperties amp = AreaMassProperties.Compute(cut);
        areas.Add(amp.Area);
        parts.Add(cut);
      }
      this.TowerP = parts[areas.IndexOf(areas.Min())];
    }

    // cut the area with pri/sec lines
    public void getSecTowerBase (double density)
    {
      // brp of self
      if (this.SecLns.Count == 0) { return; }
      Brep[] brp = Brep.CreatePlanarBreps(this.OuterBorder, inter_tol);
      // ensure no duplicated curves here !important
      List<Curve> joins = new List<Curve>();
      List<Point3d> start = new List<Point3d>();
      List<Point3d> end = new List<Point3d>();
      foreach (Curve cv in this.SecLns) {
        if (start.Contains(cv.PointAtStart)) { continue; }
        if (end.Contains(cv.PointAtEnd)) { continue; }
        start.Add(cv.PointAtStart);
        end.Add(cv.PointAtEnd);
        joins.Add(cv);
      }
      Curve[] c = Curve.JoinCurves(joins, inter_tol);
      double off = density * (this.offsetMax() - 2);
      Curve[] offset = c[0].Offset(this.Center, Vector3d.ZAxis, off, inter_tol, CurveOffsetCornerStyle.Sharp);
      if (!offset[0].IsValid) { return; }
      Curve extended = offset[0].Extend(CurveEnd.Both, extent, CurveExtensionStyle.Line);
      Brep[] cutted = brp[0].Split(new List<Curve> {extended}, inter_tol);
      cutted = cutted.Where(brptmp => brptmp != null).ToArray();
      if (cutted.Length == 0) { return; }
      List<double> areas = new List<double>();
      List<Brep> parts = new List<Brep>();
      foreach (Brep cut in cutted) {
        AreaMassProperties amp = AreaMassProperties.Compute(cut);
        areas.Add(amp.Area);
        parts.Add(cut);
      }
      this.TowerS = parts[areas.IndexOf(areas.Min())];
    }

    // extrude and move the towers to the top
    public void towerGenerator (double density, double ratio)
    {
      // tower height calculation
      Brep basement = Brep.CreatePlanarBreps(new List<Curve> {this.OuterBorder, this.InnerBorder}, inter_tol)[0];
      double baseArea = basement.GetArea();
      Brep block = Brep.CreatePlanarBreps(new List<Curve> {this.Outline.ToNurbsCurve()}, inter_tol)[0];
      double blockArea = block.GetArea();
      double baseBSR = baseArea / blockArea;
      double floor = 5;
      double baseFAR = baseBSR * floor;
      double tArea = Math.Abs((this.FAR - baseFAR) * blockArea);
      // need remap the area and height
      if (tArea <= 0) { return; }
      var moveZ = Rhino.Geometry.Transform.Translation(new Vector3d(0, 0, floor * 3));
      if (this.TowerP != null) {
        // extrude and move - primary
        double tAreaP = this.TowerP.GetArea();
        double theightP = Math.Floor(tArea * ratio / tAreaP);
        // be attention of the height, +1 is needed
        Brep exP = this.TowerP.Faces[0].CreateExtrusion(new Line(0, 0, 0, 0, 0, theightP + 1).ToNurbsCurve(), true);
        exP.Transform(moveZ);
        this.TowerPStructure = exP;
      }
      if (this.TowerS != null) {
        // extrude and move - secondary
        double tAreaS = this.TowerS.GetArea();
        double theightS = Math.Floor(tArea * (1 - ratio) / tAreaS);
        Brep exS = this.TowerS.Faces[0].CreateExtrusion(new Line(0, 0, 0, 0, 0, theightS + 1).ToNurbsCurve(), true);
        exS.Transform(moveZ);
        this.TowerSStructure = exS;
      }
    }
  }
# ---------- end c_script_5 ----------

preview_5 = CustomPreview(Geometry=c_script_5.TowerP, Shader=ColourSwatch(SwatchColor=RGB(219, 145, 145)))
preview_6 = CustomPreview(Geometry=c_script_5.Buildings, Shader=ColourSwatch(SwatchColor=RGB(235, 204, 204)))
preview_7 = CustomPreview(Geometry=c_script_5.TowerS, Material=ColourSwatch(SwatchColor=RGB(224, 164, 164)))

cluster_2 = Cluster_2(srf=c_script_5.Yard, crv=c_script_5.Yard, crv_3=geo_5)  # -> srf_3, G_2, G_3, G
preview_8 = CustomPreview(Geometry=cluster_2.G, Material=ColourSwatch(SwatchColor=RGB(54, 168, 63)))

# ----
# Final Output Elements
# ON:
# Boundary + Primary Road + Secondary Road + Minor Road
# Pedestrian Outline
# Block Buildings + Towers
# Green Space
# 
# OFF:
# Street Offset
# Building Foorprint
# Colored Density Map
# Time Consumed (5,800,000 sqm)
# PART A I: 922ms
# PART A II: 47ms
# PART B I: 7.2s
# PART B II: 3.5s
panel = Panel("TEXT: ")

# ----
# Building Visualization
# Green Space Visualization
preview_9 = CustomPreview(Geometry=cluster_2.srf_3, Material=ColourSwatch(SwatchColor=RGB(109, 158, 136)))
preview_10 = CustomPreview(Geometry=cluster_2.G_2, Material=ColourSwatch(SwatchColor=RGB(37, 128, 81)))
preview_11 = CustomPreview(Geometry=cluster_2.G_3, Material=ColourSwatch(SwatchColor=RGB(150, 212, 152)))

# ----
# Text In Plan View
number_slider_4 = Slider(12.55, range=0..100)
number_slider_5 = Slider(20000, range=0..100000)
join = TextJoin(Text=[panel, number_slider_4])
pt = Point(<point referenced from the Rhino model>)
tag = TextTag3D(Location=pt, Text=join, Size=Slider(45, range=0..100), Colour=ColourSwatch(SwatchColor=RGB(0, 0, 0)), Justification=7)

# ==== cluster Cluster
geo = ClusterInput()
geo_2 = Geometry(geo)
geo_3 = ClusterOutput(geo_2)
lng = ListLength(List=geo_2)
random = Random(Range="80 to 255", Number=lng, Seed=2, Integers=True)
rgb = ColourRGB(Alpha=255, Red=random, Green=0, Blue=0)
C = ClusterOutput(rgb)

# ==== cluster Display
geo = ClusterInput()  # disabled
K = ClusterInput()
F = ClusterInput()  # disabled
geo_2 = Geometry(geo)  # disabled
sort = SortList(Keys=K)  # -> Keys, ValuesA
Z = UnitZ(Factor=F)  # disabled
item = ListItem(List=sort.Keys, Index="-1", Wrap=True)
t = ClusterInput()
item_2 = ListItem(List=sort.Keys, Index=0, Wrap=True)
extr = Extrude(Base=geo_2, Direction=Z)  # disabled
gradient = Gradient(
    LowerLimit=item_2,
    UpperLimit=item,
    Parameter=t,
    stops=[0: RGB(67, 31, 184), 0: RGB(194, 171, 114), 0: RGB(94, 112, 149), 0: RGB(143, 31, 220), 0: RGB(125, 46, 50), 0: RGB(69, 169, 30), 0: RGB(121, 216, 76), 0: RGB(38, 209, 233), 0: RGB(63, 204, 142), 0: RGB(111, 51, 233)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])
E = ClusterOutput(extr)  # disabled
C = ClusterOutput(gradient)

# ==== cluster Cluster_2
srf = ClusterInput()
crv = ClusterInput()
geo = Geometry(<mesh referenced from the Rhino model>)
srf_2 = Surface(srf)
geo_2 = Geometry(<mesh referenced from the Rhino model>)
crv_2 = Curve(crv)
srf_3 = ClusterOutput(srf_2)
bbox = BoundingBox(Content=geo_2, Plane=PlaneXY(0, 0, 0))  # -> Box, Box_2
bbox_2 = BoundingBox(Content=geo, Plane=PlaneXY(0, 0, 0))  # -> Box, Box_2
pop2d = Populate2D(Region=crv_2, Count=Slider(15, range=0..100), Seed=crv_2)  # -> flatten(Population)
debrep = DeconstructBrep(Brep=bbox.Box_2)  # -> Faces, Edges, Vertices
debrep_2 = DeconstructBrep(Brep=bbox_2.Box_2)  # -> Faces, Edges, Vertices
pl = ConstructPlane(Origin=pop2d, XAxis=Vector(1, 0, 0), YAxis=Vector(0, 1, 0))  # -> flatten(Plane)
item = ListItem(List=debrep_2.Faces, Index=Slider(4, range=0..100), Wrap=True)
item_2 = ListItem(List=debrep.Faces, Index=Slider(4, range=0..100), Wrap=True)
crv_3 = ClusterInput()
cull = CullPattern(List=pl, CullPattern=[False, False, True, True])
area = Area(Geometry=item_2)  # -> Area, Centroid
crv_4 = Curve(crv_3)
area_2 = Area(Geometry=item)  # -> Area, Centroid
divlength = DivideLength(Curve=crv_4, Length=Slider(15, range=5..15))  # -> Points, Tangents, Parameters
lng = ListLength(List=cull)
vec2pt = Vector2Pt(PointA=area.Centroid, PointB=cull, Unitize=False)  # -> Vector, Length
cull_2 = CullPattern(List=pl, CullPattern=[True, True, False, False])
vec2pt_2 = Vector2Pt(PointA=area_2.Centroid, PointB=cull_2, Unitize=False)  # -> Vector, Length
lng_2 = ListLength(List=cull_2)
move = Move(Geometry=geo_2, Motion=vec2pt.Vector)  # -> Geometry, Transform
random = Random(Range=Domain(0, 1), Number=lng, Seed=2)
vec2pt_3 = Vector2Pt(PointA=area_2.Centroid, PointB=divlength.Points, Unitize=False)  # -> Vector, Length
move_2 = Move(Geometry=geo, Motion=vec2pt_2.Vector)  # -> Geometry, Transform
random_2 = Random(Range=Domain(0, 1), Number=lng_2, Seed=2)
move_3 = Move(Geometry=geo, Motion=vec2pt_3.Vector)  # -> Geometry, Transform
rotate = Rotate(Geometry=move.Geometry, Angle=random, Plane=cull)  # -> Geometry, Transform
rotate_2 = Rotate(Geometry=move_2.Geometry, Angle=random_2, Plane=cull_2)  # -> Geometry, Transform
G = ClusterOutput(move_3.Geometry)
G_2 = ClusterOutput(rotate.Geometry)
G_3 = ClusterOutput(rotate_2.Geometry)
